# Grasshopper definition 00_robot_toolpath_creator.gh (Grasshopper 1.0.8)

# ---- group: load_path_from_json_and_transform / new_work_object_frame
X = UnitX(Factor=1)
Y = UnitY(Factor=1)
pt = ConstructPoint(XCoordinate=Slider(15, range=0..100), YCoordinate=Slider(23, range=0..100), ZCoordinate=0)
pl = ConstructPlane(Origin=pt, XAxis=X, YAxis=Y)
convert_plane_to_compas_frame = Python3Script(planes=pl)  # -> out, frames; inputs planes: list
# ---------- convert_plane_to_compas_frame: Python ----------
# r: compas
# venv: r8-2026

import compas
import compas_rhino
from compas.geometry import Frame
from compas_rhino.conversions import plane_to_compas_frame

print(compas_rhino.__version__)

frames = []

for p in planes:
    frame = plane_to_compas_frame(p)
    frames.append(frame)
# ---------- end convert_plane_to_compas_frame ----------

# ---- group: Workobject
X_2 = UnitX(Factor=1)
Y_2 = UnitY(Factor=1)
pt_2 = Point(<point referenced from the Rhino model>)
pl_2 = ConstructPlane(Origin=pt_2, XAxis=X_2, YAxis=Y_2)

# ---- group: create_json_from_path
crv = Curve(<curve referenced from the Rhino model>)
X_3 = UnitX(Factor=Slider(-1, range=-1..1))
divide = DivideCurve(Curve=crv, Count=Slider(10, range=0..10), Kinks=False)  # -> Points, Tangents, Parameters
pl_3 = ConstructPlane(Origin=divide.Points, XAxis=X_3, YAxis=Vector(0, 1, 0))
deplane = DeconstructPlane(Plane=pl_3)  # -> Origin, XAxis, YAxis, ZAxis
vec = Vector(deplane.ZAxis)
vdis = VectorDisplay(Anchor=deplane.Origin, Vector=vec)
convert_plane_to_compas_frame_2 = Python3Script(planes=pl_3)  # -> out, frames; inputs planes: list; same code as convert_plane_to_compas_frame
panel = Panel(convert_plane_to_compas_frame_2.frames)
create_json_file = Python3Script(work_object=pl_2, frames=convert_plane_to_compas_frame_2.frames)  # -> out, filepath; inputs frames: list
# ---------- create_json_file: Python ----------
import os
import compas
import compas_rhino
from compas.data import json_dump
from compas_rhino.conversions import plane_to_compas_frame

work_object_compas = plane_to_compas_frame(work_object)

data = {
    "workobject": work_object_compas,
    "frames": list(frames)
}

filepath = r"C:\Users\sbourgault\Documents\Github\HS2026_UR_Programming\rhino\robot_toolpath.json"

json_dump(data, filepath)
# ---------- end create_json_file ----------

# ---- group: load_path_from_json_and_transform
panel_2 = Panel("C:\Users\sbourgault\Documents\Github\HS2026_UR_Programming\rhino\robot_toolpath.json")
load_frames_from_json = Python3Script(filepath=panel_2)  # -> out, work_object_frame, frames
# ---------- load_frames_from_json: Python ----------
import os
import compas
import compas_rhino
from compas.data import json_load
from compas_rhino.conversions import frame_to_rhino

data = json_load(filepath)

work_object_frame = data["workobject"]
frames = data["frames"]
# ---------- end load_frames_from_json ----------
convert_frame_to_rhino_plane = Python3Script(workobject_frame=load_frames_from_json.work_object_frame, frames=load_frames_from_json.frames)  # -> out, work_object, planes; inputs frames: list
# ---------- convert_frame_to_rhino_plane: Python ----------
# r: compas
# venv: r8-2026

import compas
import compas_rhino
from compas.geometry import Frame
from compas_rhino.conversions import frame_to_rhino

print(compas_rhino.__version__)

planes = []
work_object = frame_to_rhino(workobject_frame)

for f in frames:
    plane = frame_to_rhino(f)
    planes.append(plane)
# ---------- end convert_frame_to_rhino_plane ----------
transform_path_to_new_frame = Python3Script(
    work_object_frame=load_frames_from_json.work_object_frame,
    new_work_object_frame=convert_plane_to_compas_frame.frames,
    frames=load_frames_from_json.frames)  # -> out, work_object_frame, frames_transformed; inputs frames: list
# ---------- transform_path_to_new_frame: Python ----------
import compas
from compas.geometry import Transformation, Translation


t = Transformation.from_frame_to_frame(work_object_frame, new_work_object_frame)

frames_transformed = []

for f in frames:
    new_frame = f.transformed(t)
    frames_transformed.append(new_frame)

new_work_object_frame = new_work_object_frame
# ---------- end transform_path_to_new_frame ----------
convert_frame_to_rhino_plane_2 = Python3Script(workobject_frame=transform_path_to_new_frame.work_object_frame, frames=transform_path_to_new_frame.frames_transformed)  # -> out, a, work_object, planes; inputs frames: list; same code as convert_frame_to_rhino_plane

# ----
panel_3 = Panel(create_json_file.filepath)
